% Simulink data dictionary dvbs2hdlReceiverData.sldd

HeaderInformation = Simulink.Bus()
  MODCOD: fixdt(0,5,0)
  FECFrame: fixdt(0,1,0)

PLSCSymbols = Simulink.Bus()
  PLSCSymb: fixdt(1,18,13), Complexity="complex"
  PLSCSymbValid: boolean

NormalizedFrequencyEstimates = Simulink.Bus()
  NormalizedCoarseFrequencyEstimate: fixdt(1,21,21)
  NormalizedFineFrequencyEstimate: fixdt(1,21,21)

SymbolSyncedSymbols = Simulink.Bus()
  SymbolSyncedDataOut: fixdt(1,18,13), Complexity="complex"
  SymbolSyncedValidOut: boolean

pilotsConstellation = Simulink.Bus()
  pilots: fixdt(1,18,13), Complexity="complex"
  pilotsValid: boolean

VisualizeCorrelationSignals = Simulink.Bus()
  PeakValueWithPilots: fixdt(1,18,15)
  PeakValueWithoutPilots: fixdt(1,18,15)
  Threshold: fixdt(1,15,12)

diagBusPLHeaderEx = Simulink.Bus()
  PLSCSymbols: Bus: PLSCSymbols
  NormalizedFrequencyEstimates: Bus: NormalizedFrequencyEstimates
  SymbolSyncedSymbols: Bus: SymbolSyncedSymbols
  pilotsConstellation: Bus: pilotsConstellation
  VisualizeCorrelationSignals: Bus: VisualizeCorrelationSignals

diagBusRxEx = Simulink.Bus()
  SymbolDemodInDataOut: fixdt(1,18,14), Complexity="complex"
  SymbolDemodInValidOut: boolean
  EndOfPLSC: boolean
  VarianceEstimate: fixdt(1,32,30)
  HeaderInformation: Bus: HeaderInformation
  diagBusPLHeaderEx: Bus: diagBusPLHeaderEx

samplecontrol = Simulink.Bus()
  start: boolean
  end: boolean
  valid: boolean